# Grasshopper definition Debug.gh (Grasshopper 1.0.7)
# plug-ins: CellsThesis

# ---- group: Environment parameters
number_slider = Slider(2, range=0..10)
number_slider_2 = Slider(0.8, range=0.8..1)
panel = Panel("C:\Users\Simon\Desktop\Cells2\Code\Cells\Environments\2chemTest.bmp")

# ---- group: Evolution Parameters
number_slider_3 = Slider(0.01, range=0..0.01)
number_slider_4 = Slider(0, range=0..100)

# ---- group: Simulation control
button = Button()
steps_per_simulation = Panel("1")
number_slider_5 = Slider(1000, range=0..1000)

# ---- group: Genome parameters
number_slider_6 = Slider(2, range=0..10)
number_slider_7 = Slider(2, range=0..10)

# ----
genome = SimulationGenomes(NumberOfChemicals=number_slider, NumberOfMaterials=number_slider_6, GenerationSize=number_slider_7)
environment = SimulationEnvironment(ChemicalDecay=number_slider_2, ChemicalNumber=number_slider, ChemicalBitmapLocation=panel)  # -> SimulationEnvironment, PointsOfStimulants
bang = ExplodeTree(Data=environment.PointsOfStimulants)  # -> Branch0, Branch1
trigger = Trigger(Interval=-100, TimerInterval=100, Target=cellsolver)  # disabled

# ---- group: Visiuliazation of environment
number_slider_8 = Slider(20, range=0..100)  # disabled
pt = Point(environment.PointsOfStimulants)  # disabled
pgroups = PointGroups(Points=pt, Distance=number_slider_8)  # -> Groups, Indices; disabled
hull = ConvexHull(Points=pgroups.Groups, Plane=PlaneXY(0, 0, 0))  # -> Hull, HullZ, Indices; disabled

# ----
cellsolver = CellSolver(
    Steps=steps_per_simulation,
    Reset=button,
    Number=number_slider_5,
    Genomes=genome,
    Environment=environment.SimulationEnvironment)  # -> Positions, Solutions, CurrentStep, ChemicalLayers, EvolutionModel, CurrentGenomeID, CurrentGeneration, AllGenomes
pt_2 = Point(bang.Branch0)
readgenome = GenomeReader(Genomes=genome)
simulation_step = Panel(cellsolver.CurrentStep)
output_model = Panel(cellsolver.EvolutionModel)
panel_2 = Panel(readgenome)

# ---- group: visuliazation of simulation
num = Number(cellsolver.ChemicalLayers)  # disabled
pt_3 = Point(cellsolver.Positions)  # disabled

# ----
trim = TrimTree(Tree=cellsolver.Solutions, Depth=1)

# ---- group: Fitness Calculation (PlaceHolder)
pdecon = Deconstruct(Point=trim)  # -> XComponent, YComponent, ZComponent
addition = Addition(A=pdecon.XComponent, B=pdecon.YComponent, C=pdecon.ZComponent)
ma = MassAddition(Input=addition)  # -> flatten(Result), PartialResults

# ----
evolution = EvolutionSolver(FitnessForGenomes=ma.Result, ProbabilityForMutation=number_slider_3, Elitism=number_slider_4)  # -> NewGenomes, BestGenome, BestFitness
