# Grasshopper definition MainScript.gh (Grasshopper 1.0.7)
# plug-ins: Anemone

max_generations = Panel("100")
loop_start = LoopStart(Count=max_generations, Trigger=Button())  # -> port, Data, Counter
generation_counter = Panel(loop_start.Counter)
simulation_parameters = Panel()
environement = CSharpScript()  # -> Out, A
simulation = CSharpScript(X=environement.A, Z=simulation_parameters)  # -> Debug, Result, Visualizer
space_interpreter = CSharpScript(X=simulation.Result)
evaluation = CSharpScript(X=space_interpreter)  # -> Fitness, VisualResults
evolution = CSharpScript(X=evaluation.Fitness)  # -> Debug, NextGeneration, CurrentBest
loop_end = LoopEnd(port=loop_start.port, Data=evolution.NextGeneration, state="Constant output")
