# Grasshopper definition ScenarioConcrete.gh (Grasshopper 1.0.7)
# plug-ins: CellsThesis

reset_simulation = Button()
# Concrete Cross Section
# Inputs
step_per_genome = Panel("250")
agents_per_simulation = Panel("1500")
number_of_chemicals = Panel("2")
number_of_materials = Panel("2")
bitmap_filepath = Panel("C:\Users\Simon\Desktop\Cells2\Code\Cells\Environments\Empty.bmp")
genome = SimulationGenomes(NumberOfChemicals=number_of_chemicals, NumberOfMaterials=number_of_materials, GenerationSize=Slider(34, range=0..100))
environment = SimulationEnvironment(ChemicalDecay=Slider(0.9, range=0..1), ChemicalNumber=number_of_chemicals, ChemicalBitmapLocation=bitmap_filepath)  # -> SimulationEnvironment, PointsOfStimulants
data = Data(genome)
data_2 = Data(environment.SimulationEnvironment)

# ----
# Simulation
cellsolver = CellSolver(Steps=step_per_genome, Reset=reset_simulation, Number=agents_per_simulation, Genomes=data, Environment=data_2)  # -> Positions, Solutions, CurrentStep, ChemicalLayers, EvolutionModel, CurrentGenome, CurrentGeneration, AllGenomes
trigger = Trigger(Interval=1, TimerInterval=5, Target=cellsolver)  # disabled

# ----
# Fitness Calculations
# 2 materials area needed
# {x;0] Are points reporesenting concrete
# 
# {x;1} Are points representing steel
panel = Panel("8")
cluster = Cluster(P=cellsolver.Solutions, D=panel, B="32")  # -> concrete, R, steel

# ----
# Evolution
evolution = EvolutionSolver(FitnessForGenomes=cluster.R, ProbabilityForMutation=Slider(0.1, range=0..0.1), Elitism=Slider(2, range=0..10))  # -> NewGenomes, BestGenome, BestFitness

# ---- group: Simulation Info
current_genome = Panel(cellsolver.CurrentGenome)
generation = Panel(cellsolver.CurrentGeneration)
# Simulation Info
step = Panel(cellsolver.CurrentStep)
item = ListItem(List=cellsolver.AllGenomes, Index=current_genome, Wrap=True)
current_best_fitness = Panel(evolution.BestFitness)
readgenome = GenomeReader(Genomes=item)
panel_2 = Panel(readgenome)

# ---- group: Save phenotypes
# Visuals
geo = Geometry([cluster.concrete, cluster.steel])
rec = DataRecorder(geo, DataLimit=-10, RecordData=True)

# ---- group: Saved Phenotypes
solution_viewer = Geometry(Tree({0}: [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], {0;1}: [], {1}: [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], {1;1}: [], {2}: [], {2;1}: [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]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))

# ----
pt = Point(cellsolver.Positions)
bang = ExplodeTree(Data=pt)  # -> Branch0, Branch1
swatch = ColourSwatch(SwatchColor=RGB(61, 53, 34))
swatch_2 = ColourSwatch(SwatchColor=RGB(255, 64, 0))
phenotype = Slider(8, range=0..47)
rep = ReplaceText(Text="{x;1}", Find="x", Replace=phenotype, RecursiveReplace=False)
rep_2 = ReplaceText(Text="{x}", Find="x", Replace=phenotype, RecursiveReplace=False)
branch = TreeBranch(Tree=solution_viewer, Path=rep_2, MaintainPaths=True)
branch_2 = TreeBranch(Tree=solution_viewer, Path=rep, MaintainPaths=True)
boundary = BoundarySurfaces(Edges=branch)
boundary_2 = BoundarySurfaces(Edges=branch_2)
preview = CustomPreview(Geometry=boundary, Material=swatch)  # disabled
preview_2 = CustomPreview(Geometry=boundary_2, Material=swatch_2)  # disabled

# ---- group: Concrete Preview
preview_3 = CustomPreview(Geometry=bang.Branch0, Material=swatch)

# ---- group: Steel Preview
preview_4 = CustomPreview(Geometry=bang.Branch1, Material=swatch_2)

# ----
cluster_2 = Cluster_2()  # -> concrete, R, steel

# ==== cluster Cluster
P = ClusterInput()
D = ClusterInput()

# ---- group: Boundary curces from point groups
number_slider = Slider(21, range=0..100)
pgroups = PointGroups(Points=P, Distance=D)  # -> Groups, Indices
prune = PruneTree(Tree=pgroups.Groups, Minimum=3, Maximum=0)
hull = ConvexHull(Points=simplify(prune), Plane=PlaneXY(0, 0, 0))  # -> simplify(Hull), HullZ, Indices

# ----
trim = TrimTree(Tree=P, Depth=1)
tstat = TreeStatistics(Tree=trim)  # -> Paths, Length, Count
tstat_2 = TreeStatistics(Tree=hull.Hull)  # -> Paths, Length, Count
series = Series(Start=0, Step=1, Count=tstat.Count)
dpath = DeconstructPath(Branch=tstat_2.Paths)
lng = ListLength(List=dpath)  # -> flatten(Length)
subtraction = Subtraction(A=lng, B=2)
item = ListItem(List=subtraction, Index=0, Wrap=True)

# ---- group: Sort into correct branches
rep = ReplaceText(Text="{x;1}", Find="x", Replace=series, RecursiveReplace=False)
rep_2 = ReplaceText(Text="{x;0}", Find="x", Replace=series, RecursiveReplace=False)
trim_2 = TrimTree(Tree=hull.Hull, Depth=item)
branch = TreeBranch(Tree=trim_2, Path=rep_2, MaintainPaths=True)
branch_2 = TreeBranch(Tree=trim_2, Path=rep, MaintainPaths=True)

# ---- group: All Concrete as tree
crv = Curve(simplify(branch))

# ---- group: All Steel
crv_2 = Curve(branch_2)

# ----
steel = ClusterOutput(crv_2)
concrete = ClusterOutput(crv)
area = Area(Geometry=crv_2)  # -> Area, Centroid
explode = Explode(Curve=crv, Recursive=True)  # -> Segments, Vertices
trim_3 = TrimTree(Tree=explode.Vertices, Depth=1)

# ---- group: Steel Area
ma = MassAddition(Input=area.Area)  # -> flatten(Result), PartialResults

# ----
pdecon = Deconstruct(Point=trim_3)  # -> XComponent, YComponent, ZComponent
sort = SortList(Keys=pdecon.YComponent, ValuesA=trim_3)  # -> Keys, reverse(ValuesA)
c_script = CSharpScript(x=ma.Result)  # -> out, A; inputs x: list
# ---------- c_script: C# ----------
    for (int i = 0; i < x.Count;i++)
    {
      if (x[i] == null)
        x[i] = 0;

    }
    A = x;
# ---------- end c_script ----------
item_2 = ListItem(List=sort.ValuesA, Index=0, Wrap=True)  # -> flatten(Item)

# ---- group: Calculate Compression zone for blobs
c_script_2 = CSharpScript()  # -> out, CompArea, CompressionHeight, CompZone; inputs SteelArea: list of Double, ConcreteSurface: tree of Curve, TopPoint: list of Point3d, Step: Double; disabled
# ---------- c_script_2: C# ----------
    int genNum = TopPoint.Count;
    List<double> compArea = new List<double>();
    List<double> x = new List<double>();

    Plane plane = new Plane(new Point3d(0, 0, 0), new Vector3d(0, 0, 1));
    DataTree<Curve> areas = new DataTree<Curve>();

    for (int i = 0; i < genNum ;i++)
    {
      double compHeight = 0;
      double curArea = 0;
      // Get all surfaces in branch
      List<Curve> allSurfaces = ConcreteSurface.Branch(i);


      //Total concrete area
      double Ac = 0;

      for (int j = 0; j < allSurfaces.Count;j++)
      {
        Ac += AreaMassProperties.Compute(allSurfaces[j]).Area;
      }
      Print("Ac er " + Ac.ToString());
      List<Curve> compZones = new List<Curve>();

      int exit = 0;
      // Main loop
      while (13 * SteelArea[i] > curArea & curArea <= Ac - 1 & compHeight <200)
      {
        compZones.Clear();
        curArea = 0;
        // Make cut line
        compHeight += Step;

        Rectangle3d rect = new Rectangle3d(plane, new Point3d(-100, -100, 0), new Point3d(300, TopPoint[i].Y - compHeight, 0));
        Curve cutCurve = rect.ToNurbsCurve();

        //Seperate surface
        for (int j = 0; j < allSurfaces.Count;j++)
        {
          Curve[] compZone = Curve.CreateBooleanDifference(allSurfaces[j], cutCurve, 0.1);
          if (compZone.Length == 1)
          {
            compZones.Add(compZone[0]);
            curArea += AreaMassProperties.Compute(compZone[0]).Area;
          }
        }


        exit++;
        if (exit > 1000)
        {
          Print("Break while loop");
          Print(curArea.ToString());
          break;

        }
        Print("Current Area is " + curArea.ToString());
        Print("compHeight is " + compHeight.ToString());

      }
      compArea.Add(curArea);
      areas.AddRange(compZones, new GH_Path(i));
      x.Add(compHeight);
    }
    CompressionHeight = x;
    CompArea = compArea;
    CompZone = areas;
# ---------- end c_script_2 ----------

# ----
c_script_3 = CSharpScript(SteelArea=c_script.A, ConcreteSurface=crv, TopPoint=item_2, Step=Slider(5, range=0..10))  # -> out, CompArea, CompressionHeight, CompZone; inputs SteelArea: list of Double, ConcreteSurface: tree of Curve, TopPoint: list of Point3d, Step: Double
# ---------- c_script_3: C# ----------
    int genNum = TopPoint.Count;
    List<double> compArea = new List<double>();
    List<double> x = new List<double>();

    Plane plane = new Plane(new Point3d(0, 0, 0), new Vector3d(0, 0, 1));
    DataTree<Curve> areas = new DataTree<Curve>();

    for (int i = 0; i < genNum ;i++)
    {
      double compHeight = 0;
      double curArea = 0;
      // Get all surfaces in branch
      List<Curve> allSurfaces = ConcreteSurface.Branch(i);


      //Total concrete area
      double Ac = 0;

      for (int j = 0; j < allSurfaces.Count;j++)
      {
        Ac += AreaMassProperties.Compute(allSurfaces[j]).Area;
      }
      Print("Ac er " + Ac.ToString());
      List<Curve> compZones = new List<Curve>();

      int exit = 0;
      // Main loop
      while (13 * SteelArea[i] > curArea & curArea <= Ac - 1 & compHeight < 200)
      {
        compZones.Clear();
        curArea = 0;
        // Make cut line
        compHeight += Step;

        Rectangle3d rect = new Rectangle3d(plane, new Point3d(-100, -100, 0), new Point3d(300, TopPoint[i].Y - compHeight, 0));
        Curve cutCurve = rect.ToNurbsCurve();

        //Seperate surface
        for (int j = 0; j < allSurfaces.Count;j++)
        {
          Print("surface " + j.ToString());
          Polyline plyln;
          allSurfaces[j].TryGetPolyline(out plyln);
          Point3d[] verticies;
          verticies = plyln.ToArray();

          double[] y = new double[verticies.Length];
          for (int k = 0; k < verticies.Length;k++)
            y[k] = verticies[k].Y;
          Array.Sort(y);

          if (200 - compHeight > y[0] & 200 - compHeight < y[y.Length - 1])
          {
            Curve[] compZone = Curve.CreateBooleanDifference(allSurfaces[j], cutCurve, 0.1);
            compZones.Add(compZone[0]);
            curArea += AreaMassProperties.Compute(compZone[0]).Area;
          }
          else if (200 - compHeight <= y[0])
          {
            curArea += AreaMassProperties.Compute(allSurfaces[j]).Area;
            compZones.Add(allSurfaces[j]);
          }


        }


        exit++;
        if (exit > 1000)
        {
          Print("Break while loop");
          Print(curArea.ToString());
          break;

        }
        Print("Current Area is " + curArea.ToString());
        Print("compHeight is " + compHeight.ToString());

      }
      compArea.Add(curArea);
      areas.AddRange(compZones, new GH_Path(i));
      x.Add(compHeight);
    }
    CompressionHeight = x;
    CompArea = compArea;
    CompZone = areas;
# ---------- end c_script_3 ----------
area_2 = Area(Geometry=crv)  # -> Area, Centroid
ma_2 = MassAddition(Input=area_2.Area)  # -> flatten(Result), PartialResults
fyd = Panel("450")

# ---- group: KN/cm^2
division = Division(A=fyd, B="10")

# ----
steel_to_concrete_weighting = Panel("32")
B = ClusterInput()
multiplication = Multiplication(A=ma.Result, B=B)

# ---- group: Weighted Area
addition = Addition(A=ma_2.Result, B=multiplication)

# ---- group: Fitness Reward for two materials
c_script_4 = CSharpScript(Steel=ma.Result, Concrete=ma_2.Result)  # -> out, A; inputs Steel: list of Double, Concrete: list of Double
# ---------- c_script_4: C# ----------
    List<double> x = new List<double>();

    for (int i = 0;i < Steel.Count;i++)
      if (Steel[i] > 0 & Concrete[i] > 0)
        x.Add(3);
      else x.Add(0);
    A = x;
# ---------- end c_script_4 ----------

# ---- group: centroid for concrete
area_3 = Area(Geometry=c_script_3.CompZone)  # -> Area, Centroid
pdecon_2 = Deconstruct(Point=area_3.Centroid)  # -> XComponent, YComponent, ZComponent

# ----
multiplication_2 = Multiplication(A=area_3.Area, B=pdecon_2.YComponent)
ma_3 = MassAddition(Input=area_3.Area)  # -> Result, PartialResults

# ---- group: centroid for concrete (continued)
ma_4 = MassAddition(Input=multiplication_2)  # -> Result, PartialResults
division_2 = Division(A=ma_4.Result, B=ma_3.Result)

# ---- group: Centroid for steel
pdecon_3 = Deconstruct(Point=area.Centroid)  # -> XComponent, YComponent, ZComponent

# ----
multiplication_3 = Multiplication(A=area.Area, B=pdecon_3.YComponent)

# ---- group: Centroid for steel (continued)
ma_5 = MassAddition(Input=multiplication_3)  # -> Result, PartialResults
division_3 = Division(A=ma_5.Result, B=graft(ma.Result))
pt = ConstructPoint(XCoordinate=0, YCoordinate=division_3, ZCoordinate=0)

# ----
pdecon_4 = Deconstruct(Point=pt)  # -> XComponent, YComponent, ZComponent

# ---- group: Moment Arm
subtraction_2 = Subtraction(A=division_2, B=pdecon_4.YComponent)

# ----
c_script_5 = CSharpScript(x=subtraction_2)  # -> out, A
# ---------- c_script_5: C# ----------
  
    if (x == null)
    A = 0;
    else A = x;
# ---------- end c_script_5 ----------

# ---- group: Moment Resistance
multiplication_4 = Multiplication(A=division, B=flatten(c_script_5.A), C=c_script_3.CompArea)

# ---- group: kNM
division_4 = Division(A=multiplication_4, B=100)

# ---- group: Fitness
division_5 = Division(A=division_4, B=addition)

# ----
addition_2 = Addition(A=division_5, B=c_script_4.A)
R = ClusterOutput(addition_2)

# ==== cluster Cluster_2
T = ClusterInput()
trim = TrimTree(Tree=T, Depth=1)
tstat = TreeStatistics(Tree=trim)  # -> Paths, Length, Count
series = Series(Start=0, Step=1, Count=tstat.Count)

# ---- group: Sort into correct branches
rep = ReplaceText(Text="{x;1}", Find="x", Replace=series, RecursiveReplace=False)
rep_2 = ReplaceText(Text="{x;0}", Find="x", Replace=series, RecursiveReplace=False)
branch = TreeBranch(Tree=T, Path=rep_2, MaintainPaths=True)
branch_2 = TreeBranch(Tree=T, Path=rep, MaintainPaths=True)

# ----
ptbins = PointToBins(SteelPts=branch_2, ConcretePts=branch, Resolution=Slider(20, range=1..200), NoGenomes=tstat.Count)  # -> out, SteelCurves, ConcreteCurves; inputs SteelPts: tree of Point3d, ConcretePts: tree of Point3d, Resolution: Int32, NoGenomes: Int32
# ---------- ptbins: C# ----------
    DataTree < Rectangle3d> concreteLocations = new DataTree<Rectangle3d>();
    DataTree < Rectangle3d> steelLocations = new DataTree<Rectangle3d>();



    // 1 For each genome count points in boxes
    for (int i = 0; i < NoGenomes;i++)
    {
      int[,,] counter = new int[Resolution, Resolution, 2];
      double binWidth = 200 / Resolution;

      List<Point3d> curConcrete = ConcretePts.Branch(i);
      List < Point3d > curSteel = SteelPts.Branch(i);
      List<Rectangle3d> curConcreteRect = new List<Rectangle3d>();
      List<Rectangle3d> curSteelRect = new List<Rectangle3d>();

      // Count points in each square
      for (int j = 0;j < curConcrete.Count ;j++)
      {

        int x = Math.Min((int) Math.Round((curConcrete[j].X / binWidth)), Resolution - 1);
        int y = Math.Min((int) Math.Round((curConcrete[j].Y / binWidth)), Resolution - 1);
        counter[x, y, 0]++;

      }
      for (int j = 0;j < curSteel.Count ;j++)
      {
        int x = Math.Min((int) Math.Round((curSteel[j].X / binWidth)), Resolution - 1);
        int y = Math.Min((int) Math.Round((curSteel[j].Y / binWidth)), Resolution - 1);
        counter[x, y, 1]++;

      }

      // 2 For each genome, draw boxes and add to tree
      for (int j = 0;j < Resolution;j++)
        for (int k = 0;k < Resolution;k++)
        {
          Print("Steel value =" + counter[j, k, 1].ToString());
          Print("Concrete value =" + counter[j, k, 0].ToString());

          if (counter[j, k, 0] == 0 & counter[j, k, 1] == 0)
          {
            Print("Pass");
            continue;
          } else if (counter[j, k, 0] >= counter[j, k, 1])
          {
            Print("Concrete drawn");
            curConcreteRect.Add(DrawRect(Resolution, j, k));
          } else
          {
            curSteelRect.Add(DrawRect(Resolution, j, k));
            Print("Steel drawn");
          }

        }
      concreteLocations.AddRange(curConcreteRect, new GH_Path(i));
      steelLocations.AddRange(curSteelRect, new GH_Path(i));
    }



    // 3 return tree
    ConcreteCurves = concreteLocations;
    SteelCurves = steelLocations;
# ---------- ptbins: C# additional code ----------
  Rectangle3d DrawRect(int Resolution, int x, int y)
  {
    int width = 200 / Resolution;
    Plane plane = new Plane(new Point3d(0, 0, 0), new Vector3d(0, 0, 1));
    Point3d cornerA = new Point3d(x * width, y * width, 0);
    Point3d cornerB = new Point3d((x + 1) * width, (y + 1) * width, 0);
    Rectangle3d rect = new Rectangle3d(plane, cornerA, cornerB);
    return rect;
  }
# ---------- end ptbins ----------
runion = RegionUnion(Curves=ptbins.ConcreteCurves)
runion_2 = RegionUnion(Curves=ptbins.SteelCurves)

# ---- group: All Steel
crv = Curve(runion_2)

# ---- group: All Concrete as tree
crv_2 = Curve(simplify(runion))

# ----
steel = ClusterOutput(crv)
concrete = ClusterOutput(crv_2)
area = Area(Geometry=crv)  # -> Area, Centroid
explode = Explode(Curve=crv_2, Recursive=True)  # -> Segments, Vertices
trim_2 = TrimTree(Tree=explode.Vertices, Depth=1)

# ---- group: Steel Area
ma = MassAddition(Input=area.Area)  # -> flatten(Result), PartialResults

# ----
pdecon = Deconstruct(Point=trim_2)  # -> XComponent, YComponent, ZComponent
boundary = BoundarySurfaces(Edges=crv_2)
sort = SortList(Keys=pdecon.YComponent, ValuesA=trim_2)  # -> Keys, reverse(ValuesA)
number_slider = Slider(0.7, range=0..1)
item = ListItem(List=sort.ValuesA, Index=0, Wrap=True)  # -> flatten(Item)
c_script = CSharpScript(x=ma.Result)  # -> out, A; inputs x: list; same code as c_script
bang = ExplodeTree(Data=boundary)  # -> Branch0, Branch1, Branch2, Branch3
item_2 = ListItem(List=flatten(boundary), Index=0, Wrap=True)
area_2 = Area(Geometry=crv_2)  # -> Area, Centroid
c_script_2 = CSharpScript(SteelArea=c_script.A, ConcreteSurface=crv_2, TopPoint=item, Step=Slider(1, range=0..10))  # -> out, CompArea, CompressionHeight, CompZone; inputs SteelArea: list of Double, ConcreteSurface: tree of Curve, TopPoint: list of Point3d, Step: Double
# ---------- c_script_2: C# ----------
    int genNum = TopPoint.Count;
    List<double> compArea = new List<double>();
    List<double> x = new List<double>();

    Plane plane = new Plane(new Point3d(0, 0, 0), new Vector3d(0, 0, 1));
    DataTree<Curve> areas = new DataTree<Curve>();

    for (int i = 0; i < genNum ;i++)
    {
      double compHeight = 0;
      double curArea = 0;
      // Get all surfaces in branch
      List<Curve> allSurfaces = ConcreteSurface.Branch(i);


      //Total concrete area
      double Ac = 0;

      for (int j = 0; j < allSurfaces.Count;j++)
      {
        Ac += AreaMassProperties.Compute(allSurfaces[j]).Area;
      }
      Print("Ac er " + Ac.ToString());
      List<Curve> compZones = new List<Curve>();

      int exit = 0;
      // Main loop
      while (13 * SteelArea[i] > curArea & curArea <= Ac - 1 & compHeight < 200)
      {
        compZones.Clear();
        curArea = 0;
        // Make cut line
        compHeight += Step;

        Rectangle3d rect = new Rectangle3d(plane, new Point3d(-100, -100, 0), new Point3d(300, TopPoint[i].Y - compHeight, 0));
        Curve cutCurve = rect.ToNurbsCurve();

        //Seperate surface
        for (int j = 0; j < allSurfaces.Count;j++)
        {
          Polyline plyln;
          allSurfaces[j].TryGetPolyline(out plyln);
          Point3d[] verticies;
          verticies = plyln.ToArray();

          double[] y = new double[verticies.Length];
          for (int k = 0; k < verticies.Length;k++)
            y[k] = verticies[k].Y;
          Array.Sort(y);

          if (200 - compHeight > y[0] & 200 - compHeight < y[y.Length - 1])
          {
            Curve[] compZone = Curve.CreateBooleanDifference(allSurfaces[j], cutCurve, 0.1);
            compZones.Add(compZone[0]);
            curArea += AreaMassProperties.Compute(compZone[0]).Area;
          }
          else if (200 - compHeight <= y[0])
          {
            curArea += AreaMassProperties.Compute(allSurfaces[j]).Area;
          }


        }


        exit++;
        if (exit > 1000)
        {
          Print("Break while loop");
          Print(curArea.ToString());
          break;

        }
        Print("Current Area is " + curArea.ToString());
        Print("compHeight is " + compHeight.ToString());

      }
      compArea.Add(curArea);
      areas.AddRange(compZones, new GH_Path(i));
      x.Add(compHeight);
    }
    CompressionHeight = x;
    CompArea = compArea;
    CompZone = areas;
# ---------- end c_script_2 ----------
geo = Geometry(bang.Branch1)
ma_2 = MassAddition(Input=area_2.Area)  # -> flatten(Result), PartialResults
area_3 = Area(Geometry=bang.Branch3)  # -> Area, Centroid
crv_3 = Curve(bang.Branch2)

# ---- group: centroid for concrete
area_4 = Area()  # -> Area, Centroid
pdecon_2 = Deconstruct(Point=area_4.Centroid)  # -> XComponent, YComponent, ZComponent
lng = ListLength(List=area_4.Centroid)
ma_3 = MassAddition(Input=pdecon_2.YComponent)  # -> Result, PartialResults
ma_4 = MassAddition(Input=pdecon_2.XComponent)  # -> Result, PartialResults
ma_5 = MassAddition(Input=pdecon_2.ZComponent)  # -> Result, PartialResults
division = Division(A=ma_4.Result, B=lng)
division_2 = Division(A=ma_3.Result, B=lng)
division_3 = Division(A=ma_5.Result, B=lng)
pt = ConstructPoint(XCoordinate=division, YCoordinate=division_2, ZCoordinate=division_3)

# ---- group: Centroid for steel
pdecon_3 = Deconstruct(Point=area.Centroid)  # -> XComponent, YComponent, ZComponent
lng_2 = ListLength(List=area.Centroid)
ma_6 = MassAddition(Input=pdecon_3.YComponent)  # -> Result, PartialResults
ma_7 = MassAddition(Input=pdecon_3.XComponent)  # -> Result, PartialResults
ma_8 = MassAddition(Input=pdecon_3.ZComponent)  # -> Result, PartialResults
division_4 = Division(A=ma_7.Result, B=lng_2)
division_5 = Division(A=ma_6.Result, B=lng_2)
division_6 = Division(A=ma_8.Result, B=lng_2)
pt_2 = ConstructPoint(XCoordinate=division_4, YCoordinate=division_5, ZCoordinate=division_6)

# ----
panel = Panel(c_script_2.out)
fyd = Panel("450")
pdecon_4 = Deconstruct(Point=pt)  # -> XComponent, YComponent, ZComponent
pdecon_5 = Deconstruct(Point=pt_2)  # -> XComponent, YComponent, ZComponent

# ---- group: KN/cm^2
division_7 = Division(A=fyd, B="10")

# ---- group: Moment Arm
subtraction = Subtraction(A=pdecon_4.YComponent, B=pdecon_5.YComponent)

# ----
c_script_3 = CSharpScript(x=subtraction)  # -> out, A; same code as c_script_5

# ---- group: Moment Resistance
multiplication = Multiplication(A=division_7, B=flatten(c_script_3.A))

# ----
steel_to_concrete_weighting = Panel("32")
B = ClusterInput()

# ---- group: kNM
division_8 = Division(A=multiplication, B=100)

# ----
multiplication_2 = Multiplication(A=ma.Result, B=B)

# ---- group: Weighted Area
addition = Addition(A=ma_2.Result, B=multiplication_2)

# ---- group: Fitness
division_9 = Division(A=division_8, B=addition)

# ---- group: Fitness Reward for two materials
c_script_4 = CSharpScript(Steel=ma.Result, Concrete=ma_2.Result)  # -> out, A; inputs Steel: list of Double, Concrete: list of Double; same code as c_script_4

# ----
addition_2 = Addition(A=division_9, B=c_script_4.A)
R = ClusterOutput(addition_2)
