# Grasshopper definition ScenarioBridge.gh (Grasshopper 1.0.7)
# plug-ins: CellsThesis, Squid

# These are the setting. Each list contains a set of values to create a genome.
# Each group represents the DNA for one material
# index 1 = variable
# 0 = Chemvalue 0
# 1 = Chemvalue 1
# 2 = Cehmvalue benefit
# 3 = time
# 4 = size
# 5 = facesize
# 6 = x
# 7 = y
# 8 = directionPolar degrees
# index 2 = comparison method
# 0 = smaller than
# 1 = larger than
# 2 = always
# 3 = never
panel = Panel(" index 0 = Constant")

# ---- group: Material 1
# Genome Creation
deposit = Panel("""0
0
2""")
steer_other = Panel("""0
0
3""")
steer_steer_away_other = Panel("""0
0
3""")
steer_benefit = Panel("""0
0
2""")
steer_away_benefit = Panel("""0
0
3""")
grow_metalattice = Panel("""0
0
3""")
shrink_metalattice = Panel("""0
0
3""")
cull_self = Panel("""0
0
3""")
cull_other = Panel("""0
0
2""")
set_so_long = Panel("""0
0
3""")
set_so_short = Panel("""0
0
3""")
steer_self = Panel("""0
0
2""")
steer_away_self = Panel("""0
0
3""")
switch_material = Panel("""0
0
3""")
entwine = Entwine(
    Branch00=deposit,
    Branch01=steer_other,
    Branch02=steer_steer_away_other,
    Branch03=steer_benefit,
    Branch04=steer_away_benefit,
    Branch05=grow_metalattice,
    Branch06=shrink_metalattice,
    Branch07=cull_self,
    Branch08=cull_other,
    Branch09=set_so_long,
    Branch010=set_so_short,
    Branch011=steer_self,
    Branch012=steer_away_self,
    Branch013=switch_material,
    FlattenInputs=True)  # -> simplify(Result)

steer_away_self_2 = Panel("""0
0
3""")
switch_material_2 = Panel("""0
0
3""")
steer_self_2 = Panel("""0
0
2""")
set_so_long_2 = Panel("""0
0
3""")
cull_self_2 = Panel("""0
0
3""")
cull_other_2 = Panel("""0
0
3""")
set_so_short_2 = Panel("""0
0
3""")
shrink_metalattice_2 = Panel("""0
0
3""")
grow_metalattice_2 = Panel("""0
0
3""")
steer_benefit_2 = Panel("""0
0
2""")
steer_away_benefit_2 = Panel("""0
0
3""")
deposit_2 = Panel("""0
0
2""")
steer_other_2 = Panel("""0
0
3""")
steer_steer_away_other_2 = Panel("""0
0
2""")
entwine_2 = Entwine(
    Branch00=deposit_2,
    Branch01=steer_other_2,
    Branch02=steer_steer_away_other_2,
    Branch03=steer_benefit_2,
    Branch04=steer_away_benefit_2,
    Branch05=grow_metalattice_2,
    Branch06=shrink_metalattice_2,
    Branch07=cull_self_2,
    Branch08=cull_other_2,
    Branch09=set_so_long_2,
    Branch010=set_so_short_2,
    Branch011=steer_self_2,
    Branch012=steer_away_self_2,
    Branch013=switch_material_2,
    FlattenInputs=True)  # -> simplify(Result)

# ---- group: Unify genome
entwine_3 = Entwine(Branch0X=entwine, Branch1X=entwine_2, FlattenInputs=False)
tstat = TreeStatistics(Tree=entwine_3)  # -> Paths, Length, Count
dpath = DeconstructPath(Branch=tstat.Paths)
ins = InsertItems(List=dpath, Item="0", Indices="0", Wrap=True)
path = ConstructPath(Indices=ins)  # -> flatten(Branch)
replace = ReplacePaths(Data=entwine_3, Search=tstat.Paths, Replace=path)
merge = Merge(Data1=replace)

# ----
no_faces_in_y = Panel("1")
no_faces_in_x = Panel("1")
int = Integer(merge)
skip_current_genome = Button()
static_mesh = BooleanToggle(True)
multiplication = Multiplication(A=no_faces_in_x, B=no_faces_in_y)
mesh = Mesh(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)

# ---- group: Scenario specifics
srf = Surface([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])
srf_2 = Surface([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])
line = Line(Line((0, 25, 0), (100, 25, 0)))
# Postprocessing
panel_2 = Panel("50")

# ----
phenotype = Slider(0, range=0..47)
# Results Visualization
swatch = ColourSwatch(SwatchColor=RGB(61, 53, 34))
# Interface heatmap (only output every 10 simulation steps)
swatch_2 = ColourSwatch(SwatchColor=RGB(255, 64, 0))
rep = ReplaceText(Text="{x;1}", Find="x", Replace=phenotype, RecursiveReplace=False)
rep_2 = ReplaceText(Text="{x}", Find="x", Replace=phenotype, RecursiveReplace=False)
branch = TreeBranch(Path=rep_2, MaintainPaths=True)
branch_2 = TreeBranch(Path=rep, MaintainPaths=True)
boundary = BoundarySurfaces(Edges=branch)
boundary_2 = BoundarySurfaces(Edges=branch_2)
preview = CustomPreview(Geometry=boundary, Material=swatch)
preview_2 = CustomPreview(Geometry=boundary_2, Material=swatch_2)

number_of_chemicals = Panel("3")
number_of_materials = Panel("2")
bitmap_filepath = Panel("[Insert filepath to environment]")
reset_simulation = Button()
# Bridge
# Inputs
step_per_genome = Panel("10000")
agents_per_simulation = Panel("3000")
mplane = MeshPlane(
    Boundary={Plane=PlaneXY(0, 0, 0), Size=Domain2(u=-10..10, v=-10..10)},
    WidthCount=no_faces_in_x,
    HeightCount=no_faces_in_y)  # -> Mesh, Area
creategenome = CreateGenome(DNA=int, NumberFaces=multiplication, NumberMaterials=number_of_materials, NumberGenes="14")
data = Data(creategenome)
mesh_2 = Mesh(mplane.Mesh)

genome = SimulationGenomes(
    NumberOfChemicals=number_of_chemicals,
    NumberOfMaterials=number_of_materials,
    GenerationSize=Slider(35, range=0..100),
    FaceCount=multiplication)
environment = SimulationEnvironment(
    ChemicalDecay=Slider(0.9, range=0..1),
    ChemicalNumber=number_of_chemicals,
    ChemicalBitmapLocation=bitmap_filepath,
    MaterialNumber=number_of_materials,
    Reset=reset_simulation)  # -> SimulationEnvironment, PointsOfStimulants

data_2 = Data(environment.SimulationEnvironment)

# ----
# Simulation
cellsolver = CellSolver(
    Steps=step_per_genome,
    Reset=reset_simulation,
    Number=agents_per_simulation,
    Genomes=data,
    Environment=data_2,
    StartRuleMesh=mesh_2,
    NextGenome=skip_current_genome,
    StaticMetamesh=static_mesh,
    MasterCullingOffset="1")  # -> Positions, Solutions, CurrentStep, ChemicalLayers, EvolutionModel, CurrentGenomeID, CurrentGeneration, AllGenomes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
trigger = Trigger(Interval=10, TimerInterval=10, Target=cellsolver)  # disabled

entwine_4 = Entwine(Branch0X=cellsolver.Positions, Branch1X=cellsolver.Positions, FlattenInputs=False)  # disabled
# Discreet Geometry
# The modules Discreet Geometry, Fitness Calculations and Evolution can be turned off if simulation is unwanted. [Deafult]
delaunay = Delaunay(sensitivity_10_recommended="10", sorted_point_list=entwine_4)  # -> scaled_steel_meshes, scaled_concrete_meshes; disabled

# ----
# Fitness Calculations
# 2 materials area needed
# Everything needs to be scaled to 100x100
bridgescenario = BridgeCalculater(
    mesh=delaunay.scaled_steel_meshes,
    mesh_2=delaunay.scaled_concrete_meshes,
    free_space=srf,
    supportsurface=srf_2,
    road=line,
    deflectionlimit=panel_2)  # -> steel_phenotype, concrete_phenotype, index_for_best_phenotype, fitness_list; disabled

sqgrid = Square(Plane=PlaneXY(0, 0, 0), Size=1, ExtentX=199, ExtentY=199)  # -> flatten(Cells), flatten(Points); disabled
del = DelaunayMesh(Points=sqgrid.Points, Plane=PlaneXY(0, 0, 0))  # disabled
sort = SortList(Keys=cellsolver.CollusionCountInTheInterfaceMap)  # -> reverse(Keys), ValuesA; disabled
item = ListItem(List=sort.Keys, Index=0, Wrap=True)  # disabled
division = Division(A=cellsolver.CollusionCountInTheInterfaceMap, B=item)  # disabled
remap = RemapNumbers(Value=division, Source=Domain(0, 1), Target="1 to 0")  # -> Mapped, Clipped; disabled
demesh = DeconstructMesh(Mesh=del)  # -> Vertices, Faces, Colours, Normals; disabled
gradient = Gradient(
    LowerLimit=0,
    UpperLimit=1,
    Parameter=remap.Mapped,
    stops=[0: RGB(234, 38, 0), 0.235: RGB(234, 126, 0), 0.746: RGB(254, 244, 84), 0.845: RGB(173, 203, 249), 1: RGB(75, 107, 169)])  # disabled
conmesh = ConstructMesh(Vertices=demesh.Vertices, Faces=demesh.Faces, Colours=gradient)  # disabled
mesh_3 = Mesh(conmesh)  # disabled

# ----
# Visuals
pt = Point(cellsolver.Positions)
facen = FaceNormals(Mesh=cellsolver.CurrentRuleMesh)  # -> Centers, Normals
bang = ExplodeTree(Data=pt)  # -> Branch0, Branch1
voronoi = Voronoi(Points=facen.Centers, BruteForceOverride=False)
points = PointList(Points=facen.Centers, Size=10)
swatch_3 = ColourSwatch(SwatchColor=RGB(83, 66, 140))
pt_2 = Point(Tree({0}: [Point(60, 0, 0), Point(60, 1, 0), Point(60, 2, 0), Point(60, 3, 0), Point(60, 4, 0), Point(60, 5, 0)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], {1}: [Point(10, 49, 0), Point(11, 49, 0), Point(12, 49, 0), Point(13, 49, 0), Point(14, 49, 0), Point(15, 49, 0)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], {2}: [Point(0, 0, 0), Point(0, 1, 0), Point(0, 2, 0), Point(0, 3, 0), Point(0, 4, 0), Point(0, 5, 0)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]))
preview_3 = CustomPreview(Geometry=pt_2, Material=swatch_3)
preview_4 = CustomPreview(Geometry=voronoi, Material=swatch_3)
panel_3 = Panel("-0.5 to 0.5")

# ----
# Generate image files
panel_4 = Panel("-0.5 to 0.5")
rectangle = Rectangle(Plane=bang.Branch0, XSize=panel_4, YSize=panel_4, Radius=0)  # -> Rectangle, Length; disabled
rectangle_2 = Rectangle(Plane=bang.Branch1, XSize=panel_4, YSize=panel_4, Radius=0)  # -> Rectangle, Length; disabled
clear = Clear(Color=ColourSwatch(SwatchColor=RGB(0, 0, 0)))
fills = FillSolid(Color=ColourSwatch(SwatchColor=RGB(255, 64, 0)))
fills_2 = FillSolid(Color=ColourSwatch(SwatchColor=RGB(207, 204, 198)))
save = Save(Folder="[Set output folder]", Filename="[Put Filename]", Tiff=False)  # -> SquidInstr, Path
draw = Draw(Curve=rectangle_2.Rectangle, Accuracy=-1, Fill=fills)  # -> SquidInstr, Curve
draw_2 = Draw(Curve=rectangle.Rectangle, Accuracy=-1, Fill=fills_2)  # -> SquidInstr, Curve
rectangle_3 = Rectangle(Plane=PlaneXY(0, 0, 0), XSize="0 to 200", YSize="0 to 200", Radius=0)  # -> Rectangle, Length
merge_2 = Merge(Data1=draw_2.SquidInstr, Data2=draw.SquidInstr)
merge_3 = Merge(Data1=clear, Data2=flatten(merge_2), Data3=save.SquidInstr)
squid = Squid(BitmapR=rectangle_3.Rectangle, SquidInstr=merge_3, PPU=4, AA=True, autohide=False)  # disabled
qpreview = QuickPreview(Bitmap=squid)

# ---- group: Concrete Preview
preview_5 = CustomPreview(Geometry=bang.Branch0, Material=ColourSwatch(SwatchColor=RGB(61, 53, 34)))

# ---- group: Steel Preview
preview_6 = CustomPreview(Geometry=bang.Branch1, Material=ColourSwatch(SwatchColor=RGB(255, 64, 0)))

# ----
# Evolution
evolution = EvolutionSolver(
    FitnessForGenomes=bridgescenario.fitness_list,
    ProbabilityForMutation=Slider(0.02, range=0..1),
    Elitism=Slider(2, range=0..10))  # -> NewGenomes, BestGenome, BestFitness; disabled

current_genome = Panel(cellsolver.CurrentGenomeID)
generation = Panel(cellsolver.CurrentGeneration)
# Simulation Info
step = Panel(cellsolver.CurrentStep)
item_2 = ListItem(List=cellsolver.AllGenomes, Index=current_genome, Wrap=True)
current_best_fitness = Panel(evolution.BestFitness)

# ==== cluster BridgeCalculater: Calculates the fitness of bridges from concrete and steel
deflectionlimit = ClusterInput()
road = ClusterInput()
supportsurface = ClusterInput()
mesh = ClusterInput()
free_space = ClusterInput()
mesh_2 = ClusterInput()

# ---- group: Steel
# 0. Inputs Scaled to 100x100
mesh_3 = Mesh(mesh)

# ---- group: Free Space
srf = Surface(free_space)

# ---- group: Supports
srf_2 = Surface(supportsurface)

# ---- group: Driving
line = Line(road)

# ---- group: Deflection Limit
num = Number(deflectionlimit)

# ---- group: Concrete
mesh_4 = Mesh(mesh_2)

# ----
mesh_size = Slider(5, range=0.1..10)
disjoint = DisjointMesh(Mesh=mesh_4)
disjoint_2 = DisjointMesh(Mesh=mesh_3)
mesh_5 = Mesh(disjoint)
mesh_6 = Mesh(disjoint_2)

Y = UnitY(Factor=1)
rev = Reverse(Vector=Y)
clean = CleanTree(RemoveNulls=True, RemoveInvalid=True, RemoveEmpty=False, Tree=[mesh_6, mesh_5])
move = Move(Geometry=line, Motion=rev)  # -> Geometry, Transform
trim = TrimTree(Tree=clean, Depth=2)
mesh_7 = Mesh(trim)
debrep = DeconstructBrep(Brep=srf_2)  # -> Faces, Edges, Vertices

# ---- group: Select largest mesh
area = Area(Geometry=mesh_7)  # -> Area, Centroid
sort = SortList(Keys=area.Area)  # -> reverse(Keys), ValuesA
item = ListItem(List=sort.Keys, Index=0, Wrap=True)
lng = ListLength(List=area.Centroid)  # -> flatten(Length)
mindex = MemberIndex(Set=area.Area, Member=item)  # -> simplify(Index), Count
subtraction = Subtraction(A=lng, B=1)
item_2 = ListItem(List=mesh_7, Index=mindex.Index, Wrap=True)
cull_i = CullIndex(List=mesh_7, Indices=mindex.Index, Wrap=True)  # -> simplify(List)

# ----
# 2. Model in karamba3d
matselect = MaterialSelectionKaramba3D(menu=[dropdown(1), dropdown(4)])
matselect_2 = MaterialSelectionKaramba3D(menu=[dropdown(3), dropdown(10)])
cross_section = CrossSectionKaramba3D(FamilyNameOfCrossSection="DefaultCroSec", Material=matselect_2, Height_cm="20", mode="Shell - Const")
panel = Panel("HEB900")
panel_2 = Panel("0.5")

# ---- group: Free space
srf_3 = Surface(srf)

# ---- group: Deflection Limit
num_2 = Number(num)

# ----
debrep_2 = DeconstructBrep(Brep=srf_3)  # -> Faces, Edges, Vertices
cm_to_m = Panel("0.01")
join = JoinCurves(Curves=flatten(debrep_2.Edges), Preserve=False)

# ---- group: Find connected meshes and adjust verticies
demesh = DeconstructMesh(Mesh=item_2)  # -> Vertices, Faces, Colours, Normals
demesh_2 = DeconstructMesh(Mesh=cull_i)  # -> simplify(Vertices), Faces, Colours, Normals
trim_2 = TrimTree(Tree=demesh.Vertices, Depth=1)  # -> simplify(Tree)
c_script = CSharpScript(x=trim_2, y=subtraction)  # -> out, A; inputs x: tree, y: list of Int32
# ---------- c_script: C# ----------
    DataTree<object> outTree = new DataTree<object>();
    for (int i = 0; i < x.BranchCount ;i++)
    {
      if (x.Branch(i).Count == 0)
      {
        int[] path = new int[] {i,0};
        outTree.Add(new Point3d (200, 200, 0), new GH_Path(path));
      }
      for (int j = 0; j < y[i] ;j++)
      {
        int[] path = new int[]{i,j};
        outTree.AddRange(x.Branch(i), new GH_Path(path));
      }
    }
    A = outTree;
# ---------- end c_script ----------
verticealignementlimit = Slider(1.2, range=0..10)

# ----
cp = ClosestPoint(Point=demesh_2.Vertices, Cloud=c_script.A)  # -> ClosestPoint, CPIndex, Distance

# ---- group: Find connected meshes and adjust verticies (continued)
smaller = SmallerThan(FirstNumber=cp.Distance, SecondNumber=verticealignementlimit)  # -> SmallerThan, OrEqualTo
trim_3 = TrimTree(Tree=smaller.SmallerThan, Depth=1)
cull = CullPattern(List=cp.ClosestPoint, CullPattern=trim_3)
pt = Point(cull)
match = MatchTree(Tree=pt, Guide=demesh_2.Vertices)
lng_2 = ListLength(List=match)
trim_4 = TrimTree(Tree=lng_2, Depth=1)

# ----
# should only be checked for the other material
cp_2 = ClosestPoint(Point=match, Cloud=demesh_2.Vertices)  # -> ClosestPoint, CPIndex, Distance
# 1. Sort geometry
larger = LargerThan(FirstNumber=trim_4, SecondNumber=1)  # -> LargerThan, OrEqualTo

# ---- group: Find connected meshes and adjust verticies (continued)
replace = ReplaceItems(List=demesh_2.Vertices, Item=match, Indices=cp_2.CPIndex, Wrap=False)
conmesh = ConstructMesh(Vertices=simplify(replace), Faces=simplify(demesh_2.Faces))

# ----
trim_5 = TrimTree(Tree=conmesh, Depth=1)
mesh_8 = Mesh(item_2)

cull_2 = CullPattern(List=trim_5, CullPattern=larger.OrEqualTo)

match_2 = MatchTree(Tree=cull_2, Guide=mesh_8)
merge = Merge(Data1=mesh_8, Data2=match_2)
mesh_9 = Mesh(merge)

# ---- group: Empty DataTree for dataalignment
c_script_2 = CSharpScript(x=mesh_9)  # -> out, A; inputs x: tree
# ---------- c_script_2: C# ----------
    
    DataTree<object> tree = new DataTree<object>();
    tree = x;
    tree.ClearData();
    A = tree;
# ---------- end c_script_2 ----------

# ---- group: Full mesh
mesh_10 = Mesh(simplify(mesh_9))

# ---- group: Select correct material
mesh_11 = Mesh(mesh_6)
mesh_12 = Mesh(mesh_5)
area_2 = Area(Geometry=mesh_9)  # -> Area, Centroid
line_2 = Line(move.Geometry)

# ----
trim_6 = TrimTree(Tree=mesh_11, Depth=1)
trim_7 = TrimTree(Tree=mesh_12, Depth=1)

# ---- group: Select correct material (continued)
area_3 = Area(Geometry=trim_6)  # -> Area, Centroid
area_4 = Area(Geometry=trim_7)  # -> Area, Centroid
cp_3 = ClosestPoint(Point=area_2.Centroid, Cloud=area_4.Centroid)  # -> ClosestPoint, CPIndex, Distance
cp_4 = ClosestPoint(Point=area_2.Centroid, Cloud=area_3.Centroid)  # -> ClosestPoint, CPIndex, Distance
smaller_2 = SmallerThan(FirstNumber=cp_3.Distance, SecondNumber=verticealignementlimit)  # -> SmallerThan, OrEqualTo
smaller_3 = SmallerThan(FirstNumber=cp_4.Distance, SecondNumber=verticealignementlimit)  # -> SmallerThan, OrEqualTo
cull_3 = CullPattern(List=mesh_9, CullPattern=smaller_3.SmallerThan)
cull_4 = CullPattern(List=mesh_9, CullPattern=smaller_2.SmallerThan)

# ----
clean_2 = CombineClean(Meshes=cull_4)
clean_3 = CombineClean(Meshes=cull_3)
disjoint_3 = DisjointMesh(Mesh=clean_3)
disjoint_4 = DisjointMesh(Mesh=clean_2)

# ---- group: Concrete
mesh_13 = Mesh(simplify(disjoint_4))

# ---- group: Steel
mesh_14 = Mesh(simplify(disjoint_3))

mesh_15 = Mesh(mesh_14)

# ---- group: Concrete
mesh_16 = Mesh(mesh_13)

# ---- group: Phenotypes
# 4. Outputs
mesh_17 = Mesh(mesh_14)
mesh_18 = Mesh(mesh_13)

# ----
concrete_phenotype = ClusterOutput(mesh_18)
steel_phenotype = ClusterOutput(mesh_17)

# ---- group: Prepare FE-Geometry
join_2 = JoinCurves(Curves=flatten(debrep.Edges), Preserve=False)
clean_4 = CleanTree(RemoveNulls=True, RemoveInvalid=True, RemoveEmpty=False, Tree=mesh_14)
clean_5 = CleanTree(RemoveNulls=True, RemoveInvalid=True, RemoveEmpty=False, Tree=mesh_13)
divide = DivideCurve(Curve=line_2, Count=60, Kinks=False)  # -> Points, Tangents, Parameters
pline = PolyLine(Vertices=divide.Points, Closed=False)
int = Integer(2)

# ----
tstat = TreeStatistics(Tree=clean_5)  # -> Paths, Length, Count

# ---- group: Desired Driveway
crv = Curve(pline)

# ----
Y_2 = UnitY(Factor=1)
Y_3 = UnitY(Factor="10000")
cross_section_2 = CrossSectionKaramba3D(FamilyNameOfCrossSection="DefaultCroSec", Material=matselect, Height_cm="5", mode="Shell - Const")
rev_2 = Reverse(Vector=Y_2)
rev_3 = Reverse(Vector=Y_3)
meshtoshell = MeshToShellKaramba3D(
    Mesh=clean_4,
    Color=ColourSwatch(SwatchColor=RGB(255, 64, 0)),
    Identifier="a",
    CrossSection=cross_section_2,
    LimitDistance_m=0.005)  # -> simplify(Element), simplify(Points), Info
meshtoshell_2 = MeshToShellKaramba3D(
    Mesh=clean_5,
    Color=ColourSwatch(SwatchColor=RGB(143, 141, 113)),
    Identifier="b",
    CrossSection=cross_section,
    LimitDistance_m=0.005)  # -> simplify(Element), simplify(Points), Info
loads = LoadsKaramba3D(Vector=rev_2, mode="Gravity")

cross_section_3 = CrossSectionKaramba3D(
    FamilyNameOfCrossSection="DefaultCroSec",
    Material=matselect,
    Height_cm="90",
    UpperFlangeWidth_cm="30",
    LowerFlangeWidth_cm="30",
    UpperFlangeThickness_cm="3.5",
    LowerFlangeThickness_cm="3.5",
    WebThickness_cm="1.85",
    FilletRadius_cm="3",
    mode="I")
dup = DuplicateData(Data=loads, Number=tstat.Count, Order=True)  # -> simplify(graft(Data))
match_3 = MatchTree(Tree=meshtoshell_2.Element, Guide=c_script_2.A)
match_4 = MatchTree(Tree=meshtoshell_2.Points, Guide=c_script_2.A)
match_5 = MatchTree(Tree=meshtoshell.Element, Guide=c_script_2.A)
match_6 = MatchTree(Tree=meshtoshell.Points, Guide=c_script_2.A)

# ---- group: Prepare FE-Geometry (continued)
clean_6 = CleanTree(RemoveNulls=True, RemoveInvalid=True, RemoveEmpty=False, Tree=[match_4, match_6])
pt_2 = Point(clean_6)

# ----
tstat_2 = TreeStatistics(Tree=pt_2)  # -> Paths, Length, Count
pt_3 = Point(pt_2)
c_script_3 = CSharpScript(TreeToMap=divide.Points, LengthBranches=tstat_2.Count)  # -> out, simplify(MappedTree); inputs TreeToMap: list, LengthBranches: Int32
# ---------- c_script_3: C# ----------
    DataTree<object> mapping = new DataTree<object>();

    for (int i = 0;i < LengthBranches;i++) // for each genomes
    {
      mapping.AddRange(TreeToMap, new GH_Path(i));

    }

    MappedTree = mapping;
# ---------- end c_script_3 ----------
pull = PullPoint(Point=c_script_3.MappedTree, Geometry=pt_2, ClosestOnly=True)  # -> ClosestPoint, Distance
cp_5 = ClosestPoint(Point=c_script_3.MappedTree, Cloud=pt_2)  # -> ClosestPoint, CPIndex, Distance
larger_2 = LargerThan(FirstNumber=pull.Distance, SecondNumber=Slider(5, range=0..10))  # -> LargerThan, OrEqualTo
geo = Geometry(pull.ClosestPoint)
cull_5 = CullPattern(List=c_script_3.MappedTree, CullPattern=larger_2.LargerThan)
mindex_2 = MemberIndex(Set=larger_2.LargerThan, Member=Toggle(True))  # -> Index, Count
replace_2 = ReplaceItems(List=geo, Item=cull_5, Indices=mindex_2.Index, Wrap=False)  # -> simplify(List)

# ---- group: Prepare FE-Geometry (continued)
pline_2 = PolyLine(Vertices=replace_2, Closed=False)
explode = Explode(Curve=pline_2, Recursive=True)  # -> Segments, Vertices

# ----
merge_2 = Merge(Data1=c_script_2.A, Data2=graft(pline_2))

# ---- group: Driveway
crv_2 = Curve(merge_2)

# ----
lng_3 = ListLength(List=explode.Segments)
series = Series(Start=0, Step=1, Count=flatten(lng_3))

concat = Concatenate(FragmentA="Beam ", FragmentB=series)  # -> simplify(Result)

loads_2 = LoadsKaramba3D(Vector=rev_3, BeamIdentifiers=concat, mode="Uniform Line", menu=[buttons(off, on, off)])  # -> simplify(Load)
linetobeam = LineToBeamKaramba3D(
    Line=explode.Segments,
    Identifier=concat,
    CrossSection=cross_section_3,
    New=True,
    Remove=True,
    LimitDistance_m=0.005,
    ZOrientation=Y_3,
    Bending=True)  # -> simplify(Element), Points, Info

match_7 = MatchTree(Tree=linetobeam.Element, Guide=c_script_2.A)
match_8 = MatchTree(Tree=linetobeam.Points, Guide=c_script_2.A)

# ---- group: Prepare FE-Geometry (continued)
incurves = PointInCurves(Point=[pt_3, match_8], Curves=join_2)  # -> Relationship, Index, Point
mindex_3 = MemberIndex(Set=incurves.Relationship, Member=int)  # -> simplify(Index), Count
item_3 = ListItem(List=[pt_3, match_8], Index=mindex_3.Index, Wrap=True)
duppt = RemoveDuplicatePts(Points=item_3, Tolerance=0.01)

# ----
item_4 = ListItem(List=duppt, Index="36", Wrap=True)
load = LoadKaramba3D([loads_2, dup])
match_9 = MatchTree(Tree=load, Guide=c_script_2.A)

supp = SupportKaramba3D(PosInd=duppt, menu=[buttons(on, on, on, on, on, on)])

match_10 = MatchTree(Tree=supp, Guide=c_script_2.A)

assemble = AssembleModelKaramba3D(Elem=simplify([match_7, match_3, match_5]), Support=simplify(match_10), Load=simplify(match_9), LimitDistance_m=0.005)  # -> flatten(Model), Info, Mass_kg, CenterOfGravity
analyze = AnalyzeKaramba3D(Model=assemble.Model)  # -> CalculatedModel, MaximumDisplacement_cm, ResultingForceOfGravity_kN, ElasticEnergy_kNm

# ---- group: Add null for empty branch
lng_4 = ListLength(List=analyze.MaximumDisplacement_cm)
null = NullPlaceholder()
dispatch = Dispatch(List=null, DispatchPattern=lng_4)  # -> ListA, ListB
data = Data(simplify([analyze.MaximumDisplacement_cm, dispatch.ListB]))

# ---- group: Deflection
# 3. Calculate fitness
num_3 = Number(data)

# ----
division = Division(A=num_3, B=10)
max = Maximum(A=division, B=num_2)
division_2 = Division(A=num_2, B=max)

# ----
# Fitness Properties
# 
# Width (connected to side supports)
# Straightness of driveway
# Punishment
# Failure
# Efficiency
demesh_3 = DeconstructMesh(Mesh=mesh_10)  # -> Vertices, Faces, Colours, Normals
area_5 = Area(Geometry=mesh_15)  # -> Area, Centroid
area_6 = Area(Geometry=mesh_16)  # -> Area, Centroid
explode_2 = Explode(Curve=crv_2, Recursive=True)  # -> Segments, Vertices
explode_3 = Explode(Curve=crv, Recursive=True)  # -> Segments, Vertices
cp_6 = ClosestPoint(Point=explode_2.Vertices, Cloud=explode_3.Vertices)  # -> ClosestPoint, CPIndex, Distance
lng_5 = ListLength(List=explode_3.Vertices)
lng_6 = ListLength(List=explode_2.Vertices)  # -> flatten(Length)
ma = MassAddition(Input=cp_6.Distance)  # -> Result, PartialResults

trim_8 = TrimTree(Tree=demesh_3.Vertices, Depth=1)
trim_9 = TrimTree(Tree=demesh_3.Vertices, Depth=1)
multiplication = Multiplication(A=area_5.Area, B="5", C=cm_to_m)
multiplication_2 = Multiplication(A=area_6.Area, B="20", C=cm_to_m)
incurves_2 = PointInCurves(Point=simplify(trim_8), Curves=join)  # -> Relationship, Index, Point
ma_2 = MassAddition(Input=multiplication_2)  # -> Result, PartialResults
division_3 = Division(A=lng_6, B=lng_5)
mindex_4 = MemberIndex(Set=incurves_2.Relationship, Member=2)  # -> Index, Count
item_5 = ListItem(List=incurves_2.Relationship, Index=mindex_4.Index, Wrap=True)
subtraction_2 = Subtraction(A="100", B=ma.Result)
lng_7 = ListLength(List=item_5)
c_script_4 = CSharpScript(x=simplify(subtraction_2))  # -> out, A; inputs x: tree of Double
# ---------- c_script_4: C# ----------
    for (int i = 0; i < x.BranchCount;i++)
    {
      List<double> data = x.Branch(i);
      if (data.Count == 0)
        x.Add(0, new GH_Path(i));
    }
    A = x;
# ---------- end c_script_4 ----------
multiplication_3 = Multiplication(A=graft(division_3), B=c_script_4.A)
multiplication_4 = Multiplication(A="1", B=lng_7)
neg = Negative(Value=multiplication_4)  # -> flatten(Result)
max_2 = Maximum(A=neg, B=-50)
designzone_punishment = Panel(max_2)

pdecon = Deconstruct(Point=trim_9)  # -> XComponent, YComponent, ZComponent
multiplication_5 = Multiplication(A=multiplication, B="32")
sort_2 = SortList(Keys=pdecon.XComponent)  # -> reverse(Keys), ValuesA
sort_3 = SortList(Keys=pdecon.XComponent)  # -> Keys, ValuesA
item_6 = ListItem(List=sort_3.Keys, Index=0, Wrap=True)
item_7 = ListItem(List=sort_2.Keys, Index=0, Wrap=True)
subtraction_3 = Subtraction(A=item_7, B=item_6)
max_3 = Maximum(A=multiplication_3, B=0)

ma_3 = MassAddition(Input=multiplication_5)  # -> Result, PartialResults

# ---- group: Weigthed area
addition = Addition(A=ma_3.Result, B=ma_2.Result)

# ----
division_4 = Division(A=1, B=addition)
c_script_5 = CSharpScript(x=subtraction_3)  # -> out, A; inputs x: tree of Double
# ---------- c_script_5: C# ----------
    for (int i = 0; i < x.BranchCount;i++)
    {
      List<double> data = x.Branch(i);
      if (data.Count == 0)
        x.Add(0, new GH_Path(i,0));
    }
    A = x;
# ---------- end c_script_5 ----------

# ---- group: Fitness Scaling
multiplication_6 = Multiplication(A=division_2, B=100)
min = Minimum(A=c_script_5.A, B="190")
min_2 = Minimum(A=multiplication_6, B="100")  # -> flatten(Result)
min_3 = Minimum(A=min, B="100")  # -> flatten(Result)
min_4 = Minimum(A=max_3, B="100")  # -> flatten(Result)

# ----
multiplication_7 = Multiplication(A=division_4, B="100000")  # -> flatten(Result)
material_usage = Panel(multiplication_7)

sls_failure = Panel(min_2)
width_fitness = Panel(min_3)
driveway_support = Panel(min_4)

c_script_6 = CSharpScript(
    Failure=sls_failure,
    Materials=material_usage,
    Designzone=designzone_punishment,
    Width=width_fitness,
    Driveway=driveway_support)  # -> out, Fitness; inputs Failure: list of Double, Materials: list of Double, Designzone: list of Double, Width: list of Double, Driveway: list of Double
# ---------- c_script_6: C# ----------
    List<double> fitness = new List<double>();
    int noGenomes = Materials.Count;

    for (int i = 0; i < noGenomes ;i++)
    {
      double curFitness = 0;
      curFitness += Width[i];
      curFitness += Driveway[i];
      curFitness += Designzone[i];
      curFitness += Failure[i];
      if (Failure[i] > 99)
        curFitness += Materials[i];
      fitness.Add(curFitness);
    }

    Fitness = fitness;
# ---------- end c_script_6 ----------

# ---- group: FitnessList
num_4 = Number(c_script_6.Fitness)

# ----
sort_4 = SortList(Keys=num_4)  # -> reverse(Keys), ValuesA
fitness_list = ClusterOutput(num_4)
item_8 = ListItem(List=sort_4.Keys, Index=0, Wrap=True)
mindex_5 = MemberIndex(Set=num_4, Member=item_8)  # -> Index, Count
index_for_best_phenotype = ClusterOutput(mindex_5.Index)

# ==== cluster Delaunay: Sorts points into delaunay meshes
sensitivity_10_recommended = ClusterInput()
sorted_point_list = ClusterInput()
pgroups = PointGroups(Points=simplify(sorted_point_list), Distance=Slider(8, range=1..20))  # -> Groups, Indices
tstat = TreeStatistics(Tree=pgroups.Groups)  # -> Paths, Length, Count
smaller = SmallerThan(FirstNumber=tstat.Length, SecondNumber="3")  # -> SmallerThan, OrEqualTo
cull = CullPattern(List=tstat.Paths, CullPattern=invert(smaller.SmallerThan))
pt = Point(sorted_point_list)
branch = TreeBranch(Tree=pgroups.Groups, Path=cull, MaintainPaths=True)
del = DelaunayMesh(Points=branch, Plane=PlaneXY(0, 0, 0))  # -> simplify(Mesh)
clean = CleanTree(RemoveNulls=True, RemoveInvalid=True, RemoveEmpty=False, Tree=del)
m_fel = FaceEdgeLengths(M=clean, O=0)  # -> out, G, A, V, T, P; inputs M: Mesh
# ---------- m_fel: VB ----------
    Component.Params.Input(0).Name = "Mesh"
    Component.Params.Input(0).Description = "Open or closed mesh"
    Component.Params.Input(1).Name = "Mode"
    Component.Params.Input(1).Description = "Designates which edge length to check against (0 = Average, 1 = Min, 2 = Max)"
    Component.Params.Input(2).Name = "Length Domain"
    Component.Params.Input(2).Description = "The domain that describes the range of lengths to be tested against"

    Component.Params.Output(1).Name = "Preview Mesh"
    Component.Params.Output(1).Description = "A greyscale preview mesh reflecting the range of values"
    Component.Params.Output(2).Name = "Lengths"
    Component.Params.Output(2).Description = "The length of each face's edge specified by the Mode input"
    Component.Params.Output(3).Name = "Values"
    Component.Params.Output(3).Description = "The list of all associated values to each sample point"
    Component.Params.Output(4).Name = "Topology"
    Component.Params.Output(4).Description = "The list of index values connected to the sample point"
    Component.Params.Output(5).Name = "Pattern"
    Component.Params.Output(5).Description = "If the R input is used, the status of each sample point relative to the provided range (0 = Below, 1 = Within, 2 = Above)"

    If M IsNot Nothing Then
      Dim i,j,k,s As Integer

      Dim iP As Grasshopper.Kernel.IGH_Param = Component.Params.Input(0)
      Dim cP As Grasshopper.Kernel.Data.IGH_Structure = iP.VolatileData

      Dim mf As Rhino.Geometry.Collections.MeshFaceList = Nothing
      Dim mfn As Rhino.Geometry.Collections.MeshFaceNormalList = Nothing
      Dim mv As Rhino.Geometry.Collections.MeshVertexList = Nothing
      Dim mtv As Rhino.Geometry.Collections.MeshTopologyVertexList = Nothing
      Dim mte As Rhino.Geometry.Collections.MeshTopologyEdgeList = Nothing
      Dim mn As Rhino.Geometry.Collections.MeshVertexNormalList = Nothing
      Dim mc As Rhino.Geometry.Collections.MeshVertexColorList = Nothing

      mf = m.Faces
      mfn = m.FaceNormals
      mv = m.Vertices
      mtv = m.TopologyVertices
      mte = m.TopologyEdges
      mn = m.Normals
      mc = m.VertexColors

      Dim avgAng As New list(Of Double)
      Dim arrVal As New datatree(Of Double)
      Dim arrTop As New datatree(Of Integer)
      Dim oc As New list(Of color)
      Dim tv As Integer
      Dim aMin, aMax As Double
      Dim arrPat As New list(Of Integer)

      Dim mfo As New list(Of MeshFace)
      Dim mvo As New list(Of point3d)

      For i = 0 To mf.count() - 1 Step 1
        Dim tcv() As Integer
        tcv = mte.GetEdgesForFace(i)
        s = mvo.count()

        k = (ubound(tcv) + 1)

        If mf.item(i).isquad() Then
          mvo.add(mv.item(mf.item(i).A))
          mvo.add(mv.item(mf.item(i).B))
          mvo.add(mv.item(mf.item(i).C))
          mvo.add(mv.item(mf.item(i).D))
          mfo.add(New meshface(s, s + 1, s + 2, s + 3))
        Else
          mvo.add(mv.item(mf.item(i).A))
          mvo.add(mv.item(mf.item(i).B))
          mvo.add(mv.item(mf.item(i).C))
          mfo.add(New meshface(s, s + 1, s + 2))
        End If

        Dim tang,ang, tMin, tMax As New Double
        For j = 0 To k - 1 Step 1
          tang = mte.EdgeLine(tcv(j)).Length
          arrVal.add(tang, cp.Path(Component.RunCount - 1).AppendElement(i))
          arrTop.add(tcv(j), cp.Path(Component.RunCount - 1).AppendElement(i))
          ang += tang
          If j = 0 Then tMin = tang Else If tang < tMin Then tMin = tang
          If tang > tMax Then tMax = tang
        Next

        If O = 1 Then
          ang = tMin
        ElseIf O = 2 Then
          ang = tMax
        Else
          ang /= k
        End If

        If i = 0 Then aMin = ang Else If ang < aMin Then aMin = ang
        If ang > aMax Then aMax = ang

        avgAng.add(ang)
      Next

      If R = Nothing Then
        R.t0 = amin
        R.t1 = amax
      End If

      For i = 0 To mf.count() - 1 Step 1
        If mf.item(i).isquad() Then k = 4 Else k = 3

        If avgAng.item(i) < R.T0 Then
          For j = 0 To k - 1 Step 1
            oc.add(color.FromArgb(0, 0, 255))
          Next
          arrPat.add(0)
        ElseIf ((avgAng.item(i) > R.T1) Or ((r.t0 = 0) And (r.t1 = 0))) Then
          For j = 0 To k - 1 Step 1
            oc.add(color.FromArgb(255, 0, 0))
          Next
          arrPat.add(2)
        Else
          For j = 0 To k - 1 Step 1
            tv = math.Floor((avgAng.item(i) - R.T0) / (R.t1 - R.t0) * 255)
            oc.add(color.FromArgb(tv, tv, tv))
          Next
          arrPat.add(1)
        End If
      Next
      Dim mo As New mesh
      mo.vertices.AddVertices(mvo.toarray())
      mo.Faces.AddFaces(mfo.toarray())
      mo.VertexColors.AppendColors(oc.toarray())

      G = mo
      V = arrVal
      A = avgAng
      P = arrPat
      T = arrTop

    End If
# ---------- end m_fel ----------
larger = LargerThan(FirstNumber=m_fel.A, SecondNumber=Slider(12, range=1..20))  # -> LargerThan, OrEqualTo
mindex = MemberIndex(Set=larger.LargerThan, Member=Toggle(True))  # -> Index, Count
deletef = DeleteFaces(Mesh=clean, Indices=mindex.Index)
match = MatchTree(Tree=deletef, Guide=clean)
trim = TrimTree(Tree=match, Depth=2)
graft = GraftTree(Tree=match, IncludeEmptyLists=True, IncludeNullItems=True)
m_conface = ConnectedFaces(M=graft)  # -> out, G, A, T, P
# ---------- m_conface: VB ----------
    Component.Params.Input(0).Name = "Mesh"
    Component.Params.Input(0).Description = "Open or closed mesh"
    Component.Params.Input(1).Name = "Connected Domain"
    Component.Params.Input(1).Description = "The domain that describes the range of connected faces to be tested against"

    Component.Params.Output(1).Name = "Preview Mesh"
    Component.Params.Output(1).Description = "A greyscale preview mesh reflecting the range of values"
    Component.Params.Output(2).Name = "Connections"
    Component.Params.Output(2).Description = "The number of faces connected to each face of the mesh"
    Component.Params.Output(3).Name = "Topology"
    Component.Params.Output(3).Description = "The list of index values connected to the sample point"
    Component.Params.Output(4).Name = "Pattern"
    Component.Params.Output(4).Description = "If the R input is used, the status of each sample point relative to the provided range (0 = Below, 1 = Within, 2 = Above)"

    If M IsNot Nothing Then
      Dim i,j,k,s As Integer

      Dim iP As Grasshopper.Kernel.IGH_Param = Component.Params.Input(0)
      Dim cP As Grasshopper.Kernel.Data.IGH_Structure = iP.VolatileData

      Dim mf As Rhino.Geometry.Collections.MeshFaceList = Nothing
      Dim mfn As Rhino.Geometry.Collections.MeshFaceNormalList = Nothing
      Dim mv As Rhino.Geometry.Collections.MeshVertexList = Nothing
      Dim mtv As Rhino.Geometry.Collections.MeshTopologyVertexList = Nothing
      Dim mte As Rhino.Geometry.Collections.MeshTopologyEdgeList = Nothing
      Dim mn As Rhino.Geometry.Collections.MeshVertexNormalList = Nothing
      Dim mc As Rhino.Geometry.Collections.MeshVertexColorList = Nothing

      mf = m.Faces
      mfn = m.FaceNormals
      mv = m.Vertices
      mtv = m.TopologyVertices
      mte = m.TopologyEdges
      mn = m.Normals
      mc = m.VertexColors

      Dim arrK As New list(Of Integer)
      Dim treeK As New datatree(Of Integer)
      Dim oc As New list(Of color)
      Dim tv,tmin,tmax As Integer
      Dim arrPat As New list(Of Integer)

      Dim mfo As New list(Of MeshFace)
      Dim mvo As New list(Of point3d)

      For i = 0 To mf.count() - 1 Step 1
        Dim tcv() As Integer

        tcv = mf.AdjacentFaces(i)
        s = mvo.count()

        k = (ubound(tcv) + 1)

        If mf.item(i).isquad() Then
          mvo.add(mv.item(mf.item(i).A))
          mvo.add(mv.item(mf.item(i).B))
          mvo.add(mv.item(mf.item(i).C))
          mvo.add(mv.item(mf.item(i).D))
          mfo.add(New meshface(s, s + 1, s + 2, s + 3))
        Else
          mvo.add(mv.item(mf.item(i).A))
          mvo.add(mv.item(mf.item(i).B))
          mvo.add(mv.item(mf.item(i).C))
          mfo.add(New meshface(s, s + 1, s + 2))
        End If

        Dim tang,ang, aMin, aMax As New Double
        For j = 0 To ubound(tcv) Step 1
          treeK.add(tcv(j), cp.Path(Component.RunCount - 1).AppendElement(i))
        Next

        If k < Tmin Then Tmin = k
        If i = 0 Then Tmax = k Else If k > Tmax Then Tmax = k
        arrK.add(k)
      Next

      If R = Nothing Then
        R.t0 = Tmin
        R.t1 = Tmax
      End If

      For i = 0 To mf.count() - 1 Step 1
        If mf.item(i).isquad() Then k = 3 Else k = 2
        If arrK.item(i) < R.T0 Then
          For j = 0 To k Step 1
            oc.add(color.FromArgb(0, 0, 255))
          Next
          arrPat.add(0)
        ElseIf ((arrK.item(i) > R.T1) Or ((R.t0 = 0) And (R.t1 = 0))) Then
          For j = 0 To k Step 1
            oc.add(color.FromArgb(255, 0, 0))
          Next
          arrPat.add(2)
        Else
          For j = 0 To k Step 1
            tv = math.Floor((arrK.item(i) - R.T0) / (R.t1 - R.t0) * 255)
            oc.add(color.FromArgb(tv, tv, tv))
          Next
          arrPat.add(1)
        End If
      Next
      Dim mo As New mesh
      mo.vertices.AddVertices(mvo.toarray())
      mo.Faces.AddFaces(mfo.toarray())
      mo.VertexColors.AppendColors(oc.toarray())

      G = mo
      A = arrK
      P = arrPat
      T = treeK
    End If
# ---------- end m_conface ----------
tstat_2 = TreeStatistics(Tree=trim)  # -> Paths, Length, Count
int = Integer(0)
data = Data(m_conface.A)
mindex_2 = MemberIndex(Set=data, Member=int)  # -> Index, Count
series = Series(Start=0, Step=1, Count=tstat_2.Count)
trim_2 = TrimTree(Tree=mindex_2.Index, Depth=3)
match_2 = MatchTree(Tree=trim_2, Guide=graft)
rep = ReplaceText(Text="{x;1}", Find="x", Replace=series, RecursiveReplace=False)
rep_2 = ReplaceText(Text="{x;0}", Find="x", Replace=series, RecursiveReplace=False)
deletef_2 = DeleteFaces(Mesh=graft, Indices=match_2)
trim_3 = TrimTree(Tree=deletef_2, Depth=2)
branch_2 = TreeBranch(Tree=trim_3, Path=rep_2, MaintainPaths=True)
branch_3 = TreeBranch(Tree=trim_3, Path=rep, MaintainPaths=True)
wbcatmullclark = WeaverbirdsCatmullClarkSubdivision(MeshCurves=branch_3, Level=1, SmoothNakedEdges=1)
wbcatmullclark_2 = WeaverbirdsCatmullClarkSubdivision(MeshCurves=branch_2, Level=1, SmoothNakedEdges=1)
trim_4 = TrimTree(Tree=wbcatmullclark, Depth=1)
trim_5 = TrimTree(Tree=wbcatmullclark_2, Depth=1)
scale = Scale(Geometry=trim_4, Center=Point(0, 0, 0), Factor=0.5)  # -> Geometry, Transform
scale_2 = Scale(Geometry=trim_5, Center=Point(0, 0, 0), Factor=0.5)  # -> Geometry, Transform
scaled_concrete_meshes = ClusterOutput(scale.Geometry)
scaled_steel_meshes = ClusterOutput(scale_2.Geometry)
