# Grasshopper definition Debug2.gh (Grasshopper 1.0.7)
# plug-ins: CellsThesis

panel = Panel("C:\Users\Simon\Desktop\Cells2\Code\Cells\Environments\3chembridge.png")
panel_2 = Panel("4")
rectangle = Rectangle(Plane=PlaneXY(0, 0, 0), XSize="0 to 200", YSize="0 to 200", Radius=0)  # -> Rectangle, Length
environment = SimulationEnvironment(ChemicalDecay="0.9", ChemicalNumber="2", ChemicalBitmapLocation=panel, MaterialNumber="2")  # -> SimulationEnvironment, PointsOfStimulants; disabled
# DEBUG LIST
# 
# Size
# Setup sensory offset
# Scenario
# Genome, List output
mplane = MeshPlane(Boundary=rectangle.Rectangle, WidthCount="1", HeightCount="1")  # -> Mesh, Area
demesh = DeconstructMesh(Mesh=mplane.Mesh)  # -> Vertices, Faces, Colours, Normals
data = Data(null)
lng = ListLength(List=demesh.Faces)
genome = SimulationGenomes(NumberOfChemicals="2", NumberOfMaterials="2", GenerationSize="1", FaceCount=lng)
readgenome = GenomeReader(Genomes=genome)
trigger = Trigger(Interval=20, TimerInterval=20, Target=cellsolver)  # disabled
cellsolver = CellSolver(
    Steps="10000",
    Reset=Button(),
    Number=Slider(10, range=0..10),
    Genomes=genome,
    Environment=data,
    StartRuleMesh=mplane.Mesh)  # -> Positions, Solutions, CurrentStep, ChemicalLayers, EvolutionModel, CurrentGenomeID, CurrentGeneration, AllGenomes, CurrentRuleMesh, CurrentFaceValues
panel_3 = Panel(readgenome)
bang = ExplodeTree(Data=cellsolver.Positions)  # -> Branch0, Branch1
facen = FaceNormals(Mesh=cellsolver.CurrentRuleMesh)  # -> Centers, Normals
points = PointList(Points=facen.Centers, Size=10)
preview = CustomPreview(Geometry=bang.Branch0, Material=ColourSwatch(SwatchColor=RGB(255, 0, 0)))
preview_2 = CustomPreview(Geometry=bang.Branch1, Material=ColourSwatch(SwatchColor=RGB(0, 0, 0)))
panel_4 = Panel(cellsolver.CurrentFaceValues)
voronoi = Voronoi(Points=facen.Centers, Boundary=rectangle.Rectangle, BruteForceOverride=False)
