# Grasshopper definition ScenarioGradient.gh (Grasshopper 1.0.7)
# plug-ins: CellsThesis, Squid

# Each group represent the setting of a material.
# The values in the list represent the settting for the given discipline
# index 1 = variable
# 0 = Chemvalue 0
# 1 = Chemvalue 1
# 2 = Chemvalue 2
# 3 = mat0Density
# 4 = mat1Density
# 5 = mat2Density
# 6 = x
# 7 = y
# 8 = directionPolar degrees
# index 2 = comparison method
# 0 = smaller than
# 1 = larger than
# 2 = always
# 3 = never
panel = Panel(" index 0 = Constant")

# ---- group: HVAC
deposit = Panel("""0
0
2""")
steer_mat0 = Panel("""25
3
0""")
steer_away_mat0 = Panel("""25
3
1""")
steer_mat1 = Panel("""0
0
3""")
steer_mat2 = Panel("""0
0
2""")
steer_away_mat1 = Panel("""25
4
1""")
steer_away_mat2 = Panel("""25
4
1""")
shrink_metalattice = Panel("""0
0
3""")
cull_self = Panel("""0
0
3""")
grow_metalattice = Panel("""0
0
3""")
cull_other = Panel("""0
0
3""")
switch_material = Panel("""0
0
3""")
set_so_short = Panel("""0
0
3""")
set_so_long = Panel("""0
0
3""")
entwine = Entwine(
    Branch00=deposit,
    Branch01=steer_mat2,
    Branch02=steer_away_mat2,
    Branch03=steer_mat1,
    Branch04=steer_away_mat1,
    Branch05=grow_metalattice,
    Branch06=shrink_metalattice,
    Branch07=cull_self,
    Branch08=cull_other,
    Branch09=set_so_long,
    Branch010=set_so_short,
    Branch011=steer_mat0,
    Branch012=steer_away_mat0,
    Branch013=switch_material,
    FlattenInputs=True)  # -> simplify(Result)

# ---- group: Structures
steer_mat0_2 = Panel("""0
0
3""")
deposit_2 = Panel("""0
0
2""")
switch_material_2 = Panel("""0
0
3""")
steer_away_mat0_2 = Panel("""0
0
3""")
steer_mat1_2 = Panel("""0
0
2""")
steer_mat2_2 = Panel("""0
0
3""")
steer_away_mat2_2 = Panel("""0
0
3""")
steer_away_mat1_2 = Panel("""0
0
3""")
grow_metalattice_2 = Panel("""0
0
3""")
shrink_metalattice_2 = Panel("""0
0
3""")
cull_1 = Panel("""0
0
3""")
cull_2 = Panel("""0
0
3""")
set_so_short_2 = Panel("""0
0
3""")
set_so_long_2 = Panel("""0
0
3""")
entwine_2 = Entwine(
    Branch00=deposit_2,
    Branch01=steer_mat2_2,
    Branch02=steer_away_mat2_2,
    Branch03=steer_mat1_2,
    Branch04=steer_away_mat1_2,
    Branch05=grow_metalattice_2,
    Branch06=shrink_metalattice_2,
    Branch07=cull_1,
    Branch08=cull_2,
    Branch09=set_so_long_2,
    Branch010=set_so_short_2,
    Branch011=steer_mat0_2,
    Branch012=steer_away_mat0_2,
    Branch013=switch_material_2,
    FlattenInputs=True)  # -> simplify(Result)

# ---- group: Material 0
steer_mat0_3 = Panel("""0
0
2""")
steer_away_mat0_3 = Panel("""0
0
3""")
steer_mat1_3 = Panel("""0
0
3""")
deposit_3 = Panel("""0
0
2""")
steer_away_mat1_3 = Panel("""0
0
3""")
set_so_short_3 = Panel("""0
0
2""")
switch_material_3 = Panel("""0
0
3""")
set_so_long_3 = Panel("""0
0
3""")
steer_mat2_3 = Panel("""0
0
3""")
steer_away_mat2_3 = Panel("""0
0
3""")
cull_2_2 = Panel("""0
0
3""")
deposit_1 = Panel("""0
0
3""")
deposit_2_2 = Panel("""0
0
3""")
cull_1_2 = Panel("""25
3
1""")
entwine_3 = Entwine(
    Branch00=deposit_3,
    Branch01=steer_mat2_3,
    Branch02=steer_away_mat2_3,
    Branch03=steer_mat1_3,
    Branch04=steer_away_mat1_3,
    Branch05=deposit_1,
    Branch06=deposit_2_2,
    Branch07=cull_1_2,
    Branch08=cull_2_2,
    Branch09=set_so_long_3,
    Branch010=set_so_short_3,
    Branch011=steer_mat0_3,
    Branch012=steer_away_mat0_3,
    Branch013=switch_material_3,
    FlattenInputs=True)  # -> simplify(Result)

# ----
entwine_4 = Entwine(Branch0X=entwine_3, Branch1X=entwine_2, Branch2X=entwine, FlattenInputs=False)
tstat = TreeStatistics(Tree=entwine_4)  # -> Paths, Length, Count
dpath = DeconstructPath(Branch=tstat.Paths)
ins = InsertItems(List=dpath, Item="0", Indices="0", Wrap=True)
path = ConstructPath(Indices=ins)  # -> flatten(Branch)
replace = ReplacePaths(Data=entwine_4, Search=tstat.Paths, Replace=path)
merge = Merge(Data1=replace)

skip_current_genome = Button()
send_mesh = BooleanToggle(False)
ratio_of_discipline_agents = Panel("""33
33
33""")
int = Integer(merge)

number_of_chemicals = Panel("3")
bitmap_filepath_obstacles = Panel("[Set bitmap filepath]")
reset_simulation = Button()
bitmap_filepath_disc_2 = Panel("[Set bitmap filepath]")
# Gradient
# Set gradient map filepaths to start
# Inputs
step_per_genome = Panel("10000")
agents_per_simulation = Panel("5000")
bitmap_filepath_disc_1 = Panel("[Set bitmap filepath]")
bitmap_filepath_disc_3 = Panel("[Set bitmap filepath]")
creategenome = CreateGenome(DNA=int, NumberFaces=1, NumberMaterials=number_of_chemicals, NumberGenes="14")

# ---- group: Check bitmap
rectangle = Rectangle(Plane=PlaneXY(0, 0, 0), XSize="0 to 200", YSize="0 to 200", Radius=0)  # -> Rectangle, Length
img = ImportImage(File=bitmap_filepath_disc_2, Rectangle=rectangle.Rectangle)

# ----
environment = SimulationEnvironment(
    ChemicalDecay=Slider(0.9, range=0..1),
    ChemicalNumber=number_of_chemicals,
    ChemicalBitmapLocation1=bitmap_filepath_disc_1,
    ChemicalBitmapLocation2=bitmap_filepath_disc_2,
    ChemicalBitmapLocation3=bitmap_filepath_disc_3,
    CollisionMap=bitmap_filepath_obstacles,
    MaterialNumber=number_of_chemicals,
    Reset=reset_simulation)  # -> SimulationEnvironment, PointsOfStimulants
data = Data(creategenome)
data_2 = Data(environment.SimulationEnvironment)
mesh = Mesh(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)

# ----
# Simulation
cellsolver = CellSolver(
    Steps=step_per_genome,
    Reset=reset_simulation,
    Number=agents_per_simulation,
    Genomes=data,
    Environment=data_2,
    StartRuleMesh=mesh,
    NextGenome=skip_current_genome,
    SendChemicals=send_mesh,
    MasterCullingOffset="1",
    MaterialFractions=ratio_of_discipline_agents)  # -> Positions, Solutions, CurrentStep, ChemicalLayers, EvolutionModel, CurrentGenomeID, CurrentGeneration, AllGenomes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
trigger = Trigger(Interval=10, TimerInterval=10, Target=cellsolver)  # disabled

# ----
# Image Generation
pt = Point(cellsolver.Positions)
# Visuals
bang = ExplodeTree(Data=pt)  # -> Branch0, Branch1, Branch2

panel_2 = Panel("-0.5 to 0.5")  # disabled
rectangle_2 = Rectangle(Plane=bang.Branch0, XSize=panel_2, YSize=panel_2, Radius=0)  # -> Rectangle, Length; disabled
rectangle_3 = Rectangle(Plane=bang.Branch1, XSize=panel_2, YSize=panel_2, Radius=0)  # -> Rectangle, Length; disabled
rectangle_4 = Rectangle(Plane=bang.Branch2, XSize=panel_2, YSize=panel_2, Radius=0)  # -> Rectangle, Length; disabled
crv = Curve(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)  # disabled
outline = Outline(Color=RGB(0, 0, 0), Width=1)  # disabled
swatch = ColourSwatch(SwatchColor=RGB(255, 64, 0))  # disabled
swatch_2 = ColourSwatch(SwatchColor=RGB(156, 12, 55))  # disabled
swatch_3 = ColourSwatch(SwatchColor=RGB(91, 163, 168))  # disabled
panel_3 = Panel("[Save path]")  # disabled
panel_4 = Panel("[File name]")  # disabled
draw = Draw(Curve=crv, Accuracy=-1, Outline=outline)  # -> SquidInstr, Curve; disabled
fills = FillSolid(Color=swatch)  # disabled
panel_5 = Panel("0 to 200")  # disabled
swatch_4 = ColourSwatch(SwatchColor=RGB(255, 255, 255))  # disabled
fills_2 = FillSolid(Color=swatch_3)  # disabled
fills_3 = FillSolid(Color=swatch_2)  # disabled
save = Save(Folder=panel_3, Filename=panel_4, Tiff=False)  # -> SquidInstr, Path; disabled
draw_2 = Draw(Curve=rectangle_2.Rectangle, Accuracy=-1, Fill=fills)  # -> SquidInstr, Curve; disabled
draw_3 = Draw(Curve=rectangle_3.Rectangle, Accuracy=-1, Fill=fills_2)  # -> SquidInstr, Curve; disabled
draw_4 = Draw(Curve=rectangle_4.Rectangle, Accuracy=-1, Fill=fills_3)  # -> SquidInstr, Curve; disabled
clear = Clear(Color=swatch_4)  # disabled
merge_2 = Merge(Data1=draw_2.SquidInstr, Data2=draw_3.SquidInstr, Data3=draw_4.SquidInstr)  # disabled
rectangle_5 = Rectangle(Plane=PlaneXY(0, 0, 0), XSize=panel_5, YSize=panel_5, Radius=0)  # -> Rectangle, Length; disabled
merge_3 = Merge(Data1=clear, Data2=flatten(draw.SquidInstr), Data3=flatten(merge_2), Data4=save.SquidInstr)  # disabled
squid = Squid(BitmapR=rectangle_5.Rectangle, SquidInstr=merge_3, PPU=4, AA=True, autohide=False)  # disabled
qpreview = QuickPreview(Bitmap=squid)  # disabled

# ----
# Collision map (Only output every 10 simulation step)
bang_2 = ExplodeTree(Data=cellsolver.CollusionCountInTheInterfaceMap)  # -> Branch0, Branch1, Branch2; disabled
sqgrid = Square(Plane=PlaneXY(0, 0, 0), Size=1, ExtentX=199, ExtentY=199)  # -> flatten(Cells), flatten(Points); disabled
del = DelaunayMesh(Points=sqgrid.Points, Plane=PlaneXY(0, 0, 0))  # disabled
sort = SortList(Keys=bang_2.Branch1)  # -> reverse(Keys), ValuesA; disabled
panel_6 = Panel("1 to 0")  # disabled
item = ListItem(List=sort.Keys, Index=0, Wrap=True)  # disabled
division = Division(A=bang_2.Branch1, B=item)  # disabled
remap = RemapNumbers(Value=division, Source=Domain(0, 1), Target=panel_6)  # -> Mapped, Clipped; disabled
demesh = DeconstructMesh(Mesh=del)  # -> Vertices, Faces, Colours, Normals; disabled
gradient = Gradient(
    LowerLimit=0,
    UpperLimit=1,
    Parameter=remap.Mapped,
    stops=[0: RGB(234, 38, 0), 0.235: RGB(234, 126, 0), 0.746: RGB(254, 244, 84), 0.845: RGB(173, 203, 249), 1: RGB(75, 107, 169)])  # disabled
conmesh = ConstructMesh(Vertices=demesh.Vertices, Faces=demesh.Faces, Colours=gradient)  # disabled
mesh_2 = Mesh(conmesh)  # disabled

# ---- group: Ventilation preview
preview = CustomPreview(Geometry=bang.Branch2, Material=ColourSwatch(SwatchColor=RGB(156, 12, 55)))

# ---- group: Structures Preview
preview_2 = CustomPreview(Geometry=bang.Branch1, Material=ColourSwatch(SwatchColor=RGB(91, 163, 168)))

# ---- group: Human Preview
preview_3 = CustomPreview(Geometry=bang.Branch0, Material=ColourSwatch(SwatchColor=RGB(255, 64, 0)))
